# Dynamo custom node Collector.LinkedInstanceElements.dyf (Dynamo 0.8.2.2392)
# category: SpringNodes.Revit.Collectors
# Extract elements by category from the selected linked instances. The transform vector can be used to get the exact location of the elements in the local file

link_instance_s = Input()  # "link instance(s)"
category = Input(category:Category)
python_script = Python(IN[0]=link_instance_s, IN[1]=category)
# ---------- python_script.python (39 lines) ----------
#Copyright(c) 2015, Dimitar Venkov
# @5devene, dimitar.ven@gmail.com
#original design by Julien Benoit, @jbenoit44
# http://aecuandme.wordpress.com/

import clr

clr.AddReference("RevitNodes")
import Revit
clr.ImportExtensions(Revit.Elements)
clr.ImportExtensions(Revit.GeometryConversion)

clr.AddReference("RevitAPI")
import Autodesk
from Autodesk.Revit.DB import FilteredElementCollector, ElementCategoryFilter, XYZ

def tolist(obj1):
	if hasattr(obj1,"__iter__"):
		return obj1
	else:
		return [obj1]

Link1 = UnwrapElement(tolist(IN[0]))
Cat1 = UnwrapElement(IN[1])
elements = []
transforms = []
for l in Link1:
	LinkDoc = l.GetLinkDocument()
	fec = FilteredElementCollector(LinkDoc).OfCategoryId(Cat1.Id).WhereElementIsNotElementType().ToElements()
	fec1 = [e.ToDSType(True) for e in fec]
	elements.append(fec1)
	tf1 = l.GetTransform()
	v0 = XYZ(0,0,0)
	v1 = tf1.OfPoint(v0).ToVector(True)
	transforms.append(v1)
if len(elements) == 1:
	OUT = fec1, v1
else:
	OUT = elements, transforms
# ----------------------------------------
code_block = CodeBlock(res=python_script) { res[0]; res[1]; }
elements = Output(code_block.out0)
transform_s = Output(code_block.out1)  # "transform(s)"
