# Dynamo custom node Dictionary.ByKeysValues.dyf (Dynamo 0.8.2.2392)
# category: SpringNodes.Core
# Dictionaries are an incredibly powerful tool for making associative sets between two equal length lists. The fitst list must be of unique strings (or numbers) and will be the key and the second list will be the matching values (it can be made up of geometry, elements, even other lists)
# The search keys list will provide the coresponding value to the input key.

keys = Input()
values = Input()
search_keys = Input()
python_script = Python(IN[0]=keys, IN[1]=values, IN[2]=search_keys)
# ---------- python_script.python (22 lines) ----------
#Copyright(c) 2015, Dimitar Venkov
# @5devene, dimitar.ven@gmail.com

import clr

def tolist(obj1):
	if hasattr(obj1,"__iter__"):
		return obj1
	else:
		return [obj1]

out1 = []

keys = tolist(IN[0])
elements = tolist(IN[1])
searchVals = tolist(IN[2])
dict1 = dict(zip(keys,elements))
for v in searchVals:
	try: out1.append(dict1[v])
	except: out1.append([])
if len(out1) == 1: OUT = out1[0] 
else: OUT = out1
# ----------------------------------------
result = Output(python_script)
